vi "index.gviweb"   [G Web Development Software 22.3.0]
panel controls:
  "Usuario": string
  "Contraseña": string
  "Confirm Button": bool
  "Reset": bool
panel indicators:
  "Cluster": T1
  "body": string
  "URL Image_2": string
  "Tab": i32
  "Chart": f64
types:
  T1 = cluster{"Sensor Value": f64, "Connection": bool, "Calibration data": string}
uses:
  NI::HTTP::Open HTTP Handle.gvi
  NI::HTTP::GET.gvi
  NI::HTTP::PUT Buffer.gvi
  NI::HTTP::Close HTTP Handle.gvi
diagram:
  sequence {
    frame 0 {
      Property Node(instance in=reference to "Usuario", "Value"="")
      Property Node(instance in=reference to "Contraseña", "Value"="")
      Property Node(instance in=reference to unnamed text, "Visible"=FALSE)
      $Tab <- 0
    }
  }
  call "Open HTTP Handle.gvi"(error in=no error) -> (client handle out=w1, error out=w2)
  s1 = w2  # shift register
  s2 = w1  # shift register
  while {
    Wait(time to wait=50)
    w3 = cluster{"user": string, "password": string} {all zero or empty}
    w4 = "https://ge-iot-ad599-default-rtdb.firebaseio.com/access.json"
    call "GET.gvi"(client handle=s2, url=w4, error in=s1) -> (client handle out=w5, body=w6, error out=w7)
    Unflatten From Json(JSON string=w6, type and defaults=w3) -> (value=w8)
    case ($"Confirm Button") {
      frame False, Default {
        w9 = FALSE
      }
      frame True {
        Property Node(instance in=w8) -> ("user"=w10, "password"=w11)
        Is Equal(x=$Usuario, y=w10) -> w12
        Is Equal(x=w11, y=$Contraseña) -> w13
        Logical And(w12, w13) -> w9
        case (w9) {
          frame True {
            Property Node(instance in=reference to unnamed text, "Visible"=FALSE)
          }
          frame False {
            Property Node(instance in=reference to unnamed text, "Visible"=TRUE)
          }
        }
      }
    }
    next s1 = w7
    next s2 = w5
    stop if w9
  }
  # Top-Level WebVIs usually contain a While Loop that never stops so that they can continue running as long as the web page is open in the user's web browser.
  s3 = s2  # shift register
  s4 = s1  # shift register
  while {
    Wait(time to wait=50)
    $Tab <- 1
    w14 = "https://ge-iot-ad599-default-rtdb.firebaseio.com/data-read.json"
    Property Node(instance in=cluster{"Reset": bool} {all zero or empty}, "Reset"=$Reset) -> (instance out=w15)
    Flatten To Json(anything=w15) -> (JSON string=w16)
    call "PUT Buffer.gvi"(client handle=s3, url=w14, buffer=w16, error in=s4) -> (client handle out=w17, error out=w18)
    w19 = "https://ge-iot-ad599-default-rtdb.firebaseio.com/data-send.json"
    call "GET.gvi"(client handle=w17, url=w19, error in=w18) -> (client handle out=w20, body=w21, error out=w22)
    $body <- w21
    Unflatten From Json(JSON string=w21, type and defaults=T1 {all zero or empty}) -> (value=w23)
    $Cluster <- w23
    Property Node(instance in=w23) -> ("Sensor Value"=w24)
    $Chart <- w24
    next s3 = w20
    next s4 = w22
    stop if FALSE
  }
  call "Close HTTP Handle.gvi"(client handle=s3, error in=s4)
